# Grasshopper definition Week03_3Dprinting_FabAcademy2014_Jewerly(MN-tapeworm-script-v002).gh (Grasshopper 0.9.66)

# ---- group: Surface
steps = Slider(31, range=3..100)
range = Range(Domain="0 to 1", Steps=steps)
range_2 = Range(Domain="0 to 1", Steps=steps)
graph = GraphMapper(
    range_2,
    x0=0,
    x1=1,
    y0=-1,
    y1=1,
    container_name="Sine",
    Equation_px=[0.7437603474, 0.9507334828],
    Equation_py=[0.8065127134, 0.8200111985])
graph_2 = GraphMapper(
    range,
    x0=0,
    x1=1,
    y0=-1,
    y1=1,
    A=-0.01851946458,
    B=0.1965739244,
    container_name="Linear",
    Graph_x0=0.2692575753,
    Graph_x1=0.7551943064,
    Graph_y0=0.1915874183,
    Graph_y1=0.1825881302)
length = Slider(6.151, range=5.999..8)
width = Slider(1.8, range=0..10)
gain = Slider(11.821, range=1..100)
xy = XYPlane(Origin=Point(0, 0, 0))
tapeworm = VBScript(dir=xy, bend=flatten(graph_2), twist=flatten(graph), length=length, width=width, gain=gain)  # -> out, A, B, C; inputs dir: Plane, bend: list, twist: list
# ---------- tapeworm: VB ----------
    'your code goes here…


    ' TAPEWORM 0.2 by Mårten Nettelbladt, Omkrets arkitektur, www.omkrets.se http://thegeometryofbending.blogspot.com
    ' Written for Grasshopper v 0.8.0004
    ' 14 December 2010, Stockholm
    ' 13 January 2011, Stockholm, Notation added

    Dim x As Double = width / 2 ' Half of width
    Dim steps As Int32
    steps = bend.Count - 1    ' The number of "bend" values set the number of steps.
    Dim pt1 As Point3d
    Dim pt2 As Point3d
    Dim pts1 As New List (Of Point3d)   ' The "left" points
    Dim pts2 As New List (Of Point3d)   ' The "right" points
    Dim planes As New List (Of Plane)
    Dim dir2 As Plane
    Dim dist As Double
    dist = length / steps               ' Length of each step (at centre line). Total length / number of steps
    Dim move As Vector3d



    pt1 = dir.PointAt(-x, -Math.Tan(twist(0)) * x, 0)   'First two points. "Twist angle" decides where they go. x = half of width.
    pt2 = dir.PointAt(x, Math.Tan(twist(0)) * x, 0)

    pts1.Add(pt1)
    pts2.Add(pt2)

    Dim i As New Int32    'Starting with "1" (not "0" which is the normal) because the first value is used BEFORE the loop-
    For i = 1 To steps

      move = dir.YAxis                                   'Direction of move
      move.Transform(Transform.Scale(dir.Origin, dist))  'Distance of move (the vector is scaled)
      dir.Translate(move)

      dir2 = dir                                          'Copy of plane "dir", rotated according to "twist". Will serve as rotation axes later.
      dir2.Rotate(twist(i), dir.ZAxis, dir.Origin)        ' Rotation according to "twist"

      'planes.Add(dir)

      dir.Rotate((bend(i) / steps) * gain, dir2.XAxis, dir2.Origin)  'Plane rotated according to "bend", with rotation axes "dir2" (defined above)

      pt1 = dir.PointAt(-x, -Math.Tan(twist(i)) * x, 0)               'New point left
      pt2 = dir.PointAt(x, Math.Tan(twist(i)) * x, 0)                 'New point right

      pts1.Add(pt1)     'Points added to lists
      pts2.Add(pt2)

    Next


    A = pts1
    B = pts2
    C = planes
# ---------- end tapeworm ----------
intcrv = Interpolate(Vertices=tapeworm.A, Degree=3, Periodic=False)  # -> Curve, Length, Domain
ln = Line(PointA=tapeworm.A, PointB=tapeworm.B)
intcrv_2 = Interpolate(Vertices=tapeworm.B, Degree=3, Periodic=False)  # -> Curve, Length, Domain
loft = Loft(
    Section=[intcrv.Curve, intcrv_2.Curve],
    Options={Adjust=False, Closed=False, LoftEnds=0, LoftSimp=0, LoftType=0, Rebuild=10, Refit=0.01})

steps_2 = Slider(7, range=3..100)
range_3 = Range(Domain="0 to 1", Steps=steps_2)
range_4 = Range(Domain="0 to 1", Steps=steps_2)
graph_3 = GraphMapper(
    range_3,
    x0=0,
    x1=1,
    y0=-1,
    y1=1,
    A=-0.04780066013,
    B=0.7380747795,
    container_name="Linear",
    Graph_x0=0,
    Graph_x1=1,
    Graph_y0=0.7380747795,
    Graph_y1=0.6902741194)
graph_4 = GraphMapper(
    range_4,
    x0=0,
    x1=1,
    y0=-1,
    y1=1,
    container_name="Sine",
    Equation_px=[0.0237438865, 0.722727716],
    Equation_py=[0.8576124907, 0.8936555386])
length_2 = Slider(8, range=5..100)
width_2 = Slider(2.147, range=0..10)
gain_2 = Slider(21.992, range=1..100)
xy_2 = XYPlane(Origin=Point(0, 0, 0))
tapeworm_2 = VBScript(dir=xy_2, bend=flatten(graph_3), twist=flatten(graph_4), length=length_2, width=width_2, gain=gain_2)  # -> out, A, B, C; inputs dir: Plane, bend: list, twist: list; same code as tapeworm
intcrv_3 = Interpolate(Vertices=tapeworm_2.A, Degree=3, Periodic=False)  # -> Curve, Length, Domain
ln_2 = Line(PointA=tapeworm_2.A, PointB=tapeworm_2.B)
intcrv_4 = Interpolate(Vertices=tapeworm_2.B, Degree=3, Periodic=False)  # -> Curve, Length, Domain
loft_2 = Loft(
    Section=[intcrv_3.Curve, intcrv_4.Curve],
    Options={Adjust=False, Closed=False, LoftEnds=0, LoftSimp=0, LoftType=0, Rebuild=10, Refit=0.01})

# ----
X = UnitX(Factor=length_2)
mesh = MeshBrep(
    Brep=loft_2,
    Settings={GridMaxCount=0, GridMinCount=16, JaggedSeams=False, MaxEdgeLength=0, MinEdgeLength=0.0001, MinTolerance=0, Refine=True, RefineAngle=0, RelativeTolerance=0.65, SimplePlanes=True, Tolerance=0})
X_2 = UnitX(Factor=length)
Z = UnitZ(Factor=Slider(1, range=0..1))
dedom2 = DeconstructDomain²(Domain=loft_2)  # -> UComponent, VComponent
dom = ConstructDomain(DomainStart=Slider(0, range=0..1), DomainEnd=Slider(1, range=0..2))

# ---- group: Rectangle Contour
pt = ConstructPoint(XCoordinate=0, YCoordinate=width_2, ZCoordinate=0)
pt_2 = ConstructPoint(XCoordinate=0, YCoordinate=0, ZCoordinate=0)
ln_3 = Line(StartPoint=pt_2, EndPoint=pt)

# ----
move = Move(Geometry=ln_3, Motion=X)  # -> Geometry, Transform

# ---- group: Rectangle Contour (continued)
end = EndPoints(Curve=move.Geometry)  # -> Start, End
ln_4 = Line(StartPoint=pt_2, EndPoint=end.Start)
ln_5 = Line(StartPoint=pt, EndPoint=end.End)
join = JoinCurves(Curves=[ln_4, ln_5, ln_3, move.Geometry], Preserve=False)

# ---- group: Pattern
offset = Offset(Curve=join, Distance=Slider(0.15, range=0..1), Plane=PlaneXY(0, 0, 0), Corners=1)
pop2d = Populate2D(Region=offset, Count=Slider(10, range=0..100), Seed=Slider(8, range=0..30))
voronoi = Voronoi(Points=pop2d, Radius=Slider(5, range=0..5), Boundary=offset, BruteForceOverride=False)
faceb = FaceBoundaries(Mesh=voronoi)
area = Area(Geometry=faceb)  # -> Area, Centroid
join_2 = JoinCurves(Curves=faceb, Preserve=False)
scale = Scale(Geometry=join_2, Center=area.Centroid, Factor=Slider(0.705, range=0..1))  # -> flatten(Geometry), Transform

# ---- group: Elimate small triangles
explode = Explode(Curve=scale.Geometry, Recursive=True)  # -> Segments, Vertices
item = ListItem(List=explode.Vertices, Index=0, Wrap=True)
item_2 = ListItem(List=explode.Vertices, Index=1, Wrap=True)
item_3 = ListItem(List=explode.Vertices, Index=2, Wrap=True)
inellipse = InEllipse(CornerA=item, CornerB=item_2, CornerC=item_3)  # -> Ellipse, Plane
divide = DivideCurve(Curve=explode.Segments, Count=Slider(20, range=0..20), Kinks=False)  # -> flatten(Points), Tangents, Parameters
area_2 = Area(Geometry=inellipse.Ellipse)  # -> Area, Centroid
cp = ClosestPoint(Point=area_2.Centroid, Cloud=divide.Points)  # -> ClosestPoint, CPIndex, Distance
dist = Distance(PointA=area_2.Centroid, PointB=cp.ClosestPoint)
larger = LargerThan(FirstNumber=flatten(dist), SecondNumber=Slider(0.1, range=0..0.2))  # -> LargerThan, OrEqualTo
cull = CullPattern(List=scale.Geometry, CullPattern=larger.OrEqualTo)
crv = Curve(cull)

# ----
boundary = BoundarySurfaces(Edges=join)
fillet = Fillet(Curve=crv, Radius=Slider(0.071, range=0..1))
sdiff = SolidDifference(BrepsA=boundary, BrepsB=fillet)
rotate = Rotate(Geometry=sdiff, Angle=1.570796327, Plane=PlaneXY(0, 0, 0))  # -> Geometry, Transform
bbox = BoundingBox(Content=rotate.Geometry, Plane=Z)  # -> Box, Box_2
srfmorph = SurfaceMorph(
    Geometry=rotate.Geometry,
    Reference=bbox.Box,
    Surface=loft_2,
    UDomain=dedom2.UComponent,
    VDomain=dedom2.VComponent,
    WDomain=dom)

# ---- group: Rectangle Contour
pt_3 = ConstructPoint(XCoordinate=0, YCoordinate=width, ZCoordinate=0)
pt_4 = ConstructPoint(XCoordinate=0, YCoordinate=0, ZCoordinate=0)
ln_6 = Line(StartPoint=pt_4, EndPoint=pt_3)

# ----
move_2 = Move(Geometry=ln_6, Motion=X_2)  # -> Geometry, Transform

# ---- group: Rectangle Contour (continued)
end_2 = EndPoints(Curve=move_2.Geometry)  # -> Start, End
ln_7 = Line(StartPoint=pt_4, EndPoint=end_2.Start)
ln_8 = Line(StartPoint=pt_3, EndPoint=end_2.End)
join_3 = JoinCurves(Curves=[ln_7, ln_8, ln_6, move_2.Geometry], Preserve=False)

# ---- group: Pattern
offset_2 = Offset(Curve=join_3, Distance=Slider(0.115, range=0..1), Plane=PlaneXY(0, 0, 0), Corners=1)
pop2d_2 = Populate2D(Region=offset_2, Count=Slider(17, range=0..100), Seed=Slider(8, range=0..30))
voronoi_2 = Voronoi(Points=pop2d_2, Radius=Slider(5, range=0..5), Boundary=offset_2, BruteForceOverride=False)
faceb_2 = FaceBoundaries(Mesh=voronoi_2)
area_3 = Area(Geometry=faceb_2)  # -> Area, Centroid
join_4 = JoinCurves(Curves=faceb_2, Preserve=False)
scale_2 = Scale(Geometry=join_4, Center=area_3.Centroid, Factor=Slider(0.767, range=0..1))  # -> flatten(Geometry), Transform

# ---- group: Elimate small triangles
explode_2 = Explode(Curve=scale_2.Geometry, Recursive=True)  # -> Segments, Vertices
item_4 = ListItem(List=explode_2.Vertices, Index=0, Wrap=True)
item_5 = ListItem(List=explode_2.Vertices, Index=1, Wrap=True)
item_6 = ListItem(List=explode_2.Vertices, Index=2, Wrap=True)
inellipse_2 = InEllipse(CornerA=item_4, CornerB=item_5, CornerC=item_6)  # -> Ellipse, Plane
divide_2 = DivideCurve(Curve=explode_2.Segments, Count=Slider(20, range=0..20), Kinks=False)  # -> flatten(Points), Tangents, Parameters
area_4 = Area(Geometry=inellipse_2.Ellipse)  # -> Area, Centroid
cp_2 = ClosestPoint(Point=area_4.Centroid, Cloud=divide_2.Points)  # -> ClosestPoint, CPIndex, Distance
dist_2 = Distance(PointA=area_4.Centroid, PointB=cp_2.ClosestPoint)
larger_2 = LargerThan(FirstNumber=flatten(dist_2), SecondNumber=Slider(0.048, range=0..0.2))  # -> LargerThan, OrEqualTo
cull_2 = CullPattern(List=scale_2.Geometry, CullPattern=larger_2.OrEqualTo)
crv_2 = Curve(cull_2)

# ---- group: Project pattern on surface
boundary_2 = BoundarySurfaces(Edges=join_3)
fillet_2 = Fillet(Curve=crv_2, Radius=Slider(0.071, range=0..1))
sdiff_2 = SolidDifference(BrepsA=boundary_2, BrepsB=fillet_2)
Z_2 = UnitZ(Factor=Slider(1, range=0..1))
rotate_2 = Rotate(Geometry=sdiff_2, Angle=1.570796327, Plane=PlaneXY(0, 0, 0))  # -> Geometry, Transform
bbox_2 = BoundingBox(Content=rotate_2.Geometry, Plane=Z_2)  # -> Box, Box_2
dedom2_2 = DeconstructDomain²(Domain=loft)  # -> UComponent, VComponent
dom_2 = ConstructDomain(DomainStart=Slider(0, range=0..1), DomainEnd=Slider(1, range=0..2))
srfmorph_2 = SurfaceMorph(
    Geometry=rotate_2.Geometry,
    Reference=bbox_2.Box,
    Surface=loft,
    UDomain=dedom2_2.UComponent,
    VDomain=dedom2_2.VComponent,
    WDomain=dom_2)
